# Grasshopper definition example-usage-mesh-extruder.gh (Grasshopper 1.0.7)
# Copyright: Modelup AB

# ---- group: 200 curves
crv = Curve([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])

# ---- group: 1 curve
# Ultra-fast mesh extrusion
crv_2 = Curve(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)

# ----
# An ultra-fast mesh extrusion UserObject
# using only vanilla GH components.
crv_3 = Curve(crv_2)
X = UnitX(Factor=Slider(43.04, range=10..50))

# ---- group: Fast Extrude (UserObject)
meshextrude = FastMeshExtrusion(polyline=crv_3, extrusion_vector=X)

# ---- group: Slow Extrude (for comparison)
extr = Extrude(Base=crv_3, Direction=X)  # disabled

# ----
mesh = Mesh(meshextrude)
brep = Brep(extr)

# ==== cluster FastMeshExtrusion: Creates a simple extrusion by offsetting the curve along a vector and pair the vertices into quads. Version 1.1
# Fast mesh extrusion
# This cluster creates a simple extrusion by
# offsetting the curve along the move vector
# and pair the vertices into quads
# Changelog
# 
# 1.1
# • Support extrusions of open curves
# • Support tree structure in curve input
# 
# 1.0
# First release
polyline = ClusterInput()  # Polyline to extrude.
extrusion_vector = ClusterInput()  # Extrusion vector. Should be perpendicular to the plane of the closed polyline.
cpl = Curve(polyline)
vec = Vector(extrusion_vector)
disc = Discontinuity(Curve=cpl, Level=1)  # -> Points, Parameters
cls = Closed(Curve=cpl)  # -> Closed, Periodic
pt = Point(disc.Points)
bool = Boolean(cls.Closed)
move = Move(Geometry=pt, Motion=vec)  # -> Geometry, Transform
match = MatchTree(Tree=move.Geometry, Guide=pt)
lng = ListLength(List=pt)
merge = Merge(Data1=pt, Data2=match)

# ---- group: Create face indices 0,1,2,3 / indices for lower
# extrude direction
# input curve
series = Series(Start=0, Step=1, Count=lng)  # -> simplify(Series)

# ---- group: Create face indices 0,1,2,3 / indices for upper
series_2 = Series(Start=lng, Step=1, Count=lng)  # -> simplify(Series)

# ---- group: Create face indices 0,1,2,3 / add first index at the end
item = ListItem(List=series, Index=0, Wrap=True)  # -> simplify(Item)
merge_2 = Merge(Data1=series, Data2=item)

item_2 = ListItem(List=series_2, Index=0, Wrap=True)  # -> simplify(Item)
merge_3 = Merge(Data1=simplify(series_2), Data2=item_2)

# ---- group: Create face indices 0,1,2,3
shift = ShiftList(List=merge_2, Shift="1", Wrap=False)  # -> simplify(List)
shift_2 = ShiftList(List=merge_3, Shift="1", Wrap=False)  # -> simplify(List)

# ---- group: For closed curves
quad = MeshQuad(CornerA=series, CornerB=series_2, CornerC=shift_2, CornerD=shift)

# ---- group: For open curves
lng_2 = ListLength(List=quad)
cull_i = CullIndex(List=quad, Indices=expr("x-1", lng_2), Wrap=True)

# ---- group: Pick either open or closed face sets
isclosed = Boolean(bool)
cull = CullPattern(List=cull_i, CullPattern=invert(isclosed))  # -> simplify(List)
cull_2 = CullPattern(List=quad, CullPattern=isclosed)
merge_4 = Merge(Data1=cull_2, Data2=cull)  # -> simplify(Result)
clean = CleanTree(RemoveNulls=True, RemoveInvalid=True, RemoveEmpty=True, Tree=merge_4)

# ----
conmesh = ConstructMesh(Vertices=merge, Faces=clean)
ex = Mesh(conmesh)
extrusion_mesh = ClusterOutput(ex)  # Extruded mesh
